# Grasshopper definition BielPitman_Assignment1.gh (Grasshopper 1.0.8)
# plug-ins: Hops

hops = Hops(
    InitialLine=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,
    Intersections=Slider(10, range=0..10),
    Footprint=Slider(36, range=0..100),
    Thickness=Slider(0.5, range=0..1),
    CacheResultsInMemory=True,
    CacheSolveResults=True,
    RemoteDefinitionLocation="C:\Users\aponw\OneDrive\Escritorio\MeshFacade.gh",
    RemoteSolveVersion=(0, 1, 0),
    ShowInput_Enabled=False,
    ShowInput_Path=False,
    SynchronousSolve=True)
