# Grasshopper definition MeshFacade.gh (Grasshopper 1.0.8)

# ----
# First Block
crv = Curve(reparameterize(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))
range = Range(Domain=Domain(0, 1), Steps=Slider(11, range=0..100))
graph = GraphMapper(
    range,
    x0=0,
    x1=1,
    y0=0,
    y1=1,
    container_name="Bezier",
    cpx=[0, 0.5733547211, 0.8415967226, 1],
    cpy=[0, 0.1710309386, 0.3527998328, 1])
X = UnitX(Factor=1)
Y = UnitY(Factor=1)
Y_2 = UnitY(Factor=1)
X_2 = UnitX(Factor=1)
Y_3 = UnitY(Factor=1)
swatch = ColourSwatch(SwatchColor=RGB(190, 54, 255))

initial_line = GetGeometry(crv, AnnotationTypeFilter=3966, AtLeast=1, AtMost=1, DeleteInput=False, Filter=1074081855, TreeAccess=False)
footprint = GetInteger(Slider(41, range=0..50), AtLeast=1, AtMost=1, Maximum=2147483647, Minimum=-2147483648, TreeAccess=False)
intersections = GetInteger(Slider(11, range=1..12), AtLeast=1, AtMost=1, Maximum=2147483647, Minimum=-2147483648, TreeAccess=False)
thickness = GetNumber(Slider(0.4, range=-0.5..0.5), AtLeast=1, AtMost=1, Maximum=1.797693135e+308, Minimum=-1.797693135e+308, TreeAccess=False)

eval = EvaluateCurve(Curve=initial_line, Parameter=graph)  # -> Point, Tangent, Angle
dup = DuplicateData(Data=initial_line, Number=2, Order=True)
X_3 = UnitX(Factor=footprint)
dup_2 = DuplicateData(Data=initial_line, Number=2, Order=True)
Y_4 = UnitY(Factor=footprint)
move = Move(Geometry=dup, Motion=X_3)  # -> Geometry, Transform
eval_2 = EvaluateCurve(Curve=initial_line, Parameter=graph)  # -> Point, Tangent, Angle
move_2 = Move(Geometry=dup_2, Motion=Y_4)  # -> Geometry, Transform
line = LineSDL(Start=eval.Point, Direction=X, Length=footprint)
eval_3 = EvaluateCurve(Curve=move.Geometry, Parameter=graph)  # -> Point, Tangent, Angle
eval_4 = EvaluateCurve(Curve=move_2.Geometry, Parameter=graph)  # -> Point, Tangent, Angle
divide = DivideCurve(Curve=line, Count=intersections, Kinks=False)  # -> simplify(Points), Tangents, Parameters
line_2 = LineSDL(Start=eval_2.Point, Direction=Y, Length=footprint)
relitem = RelativeItem(Tree=divide.Points, Offset="{+1} (+1)", WrapPaths=False, WrapItems=False)  # -> ItemA, ItemB
relitem_2 = RelativeItem(Tree=divide.Points, Offset="{+1} (-1)", WrapPaths=False, WrapItems=False)  # -> ItemA, ItemB
line_3 = LineSDL(Start=eval_3.Point, Direction=Y_2, Length=footprint)
divide_2 = DivideCurve(Curve=line_2, Count=intersections, Kinks=False)  # -> simplify(Points), Tangents, Parameters
line_4 = LineSDL(Start=eval_4.Point, Direction=X_2, Length=footprint)
ln = Line(StartPoint=relitem.ItemA, EndPoint=relitem.ItemB)
ln_2 = Line(StartPoint=relitem_2.ItemA, EndPoint=relitem_2.ItemB)
Y_5 = UnitY(Factor=thickness)
relitem_3 = RelativeItem(Tree=divide_2.Points, Offset="{+1} (+1)", WrapPaths=False, WrapItems=False)  # -> ItemA, ItemB
relitem_4 = RelativeItem(Tree=divide_2.Points, Offset="{+1} (-1)", WrapPaths=False, WrapItems=False)  # -> ItemA, ItemB
divide_3 = DivideCurve(Curve=line_3, Count=intersections, Kinks=False)  # -> simplify(Points), Tangents, Parameters
extr = Extrude(Base=[ln, ln_2], Direction=Y_5)
divide_4 = DivideCurve(Curve=line_4, Count=intersections, Kinks=False)  # -> simplify(Points), Tangents, Parameters
ln_3 = Line(StartPoint=relitem_3.ItemA, EndPoint=relitem_3.ItemB)
ln_4 = Line(StartPoint=relitem_4.ItemA, EndPoint=relitem_4.ItemB)
relitem_5 = RelativeItem(Tree=divide_3.Points, Offset="{+1} (+1)", WrapPaths=False, WrapItems=False)  # -> ItemA, ItemB
relitem_6 = RelativeItem(Tree=divide_3.Points, Offset="{+1} (-1)", WrapPaths=False, WrapItems=False)  # -> ItemA, ItemB
relitem_7 = RelativeItem(Tree=divide_4.Points, Offset="{+1} (+1)", WrapPaths=False, WrapItems=False)  # -> ItemA, ItemB
Y_6 = UnitY(Factor=thickness)
relitem_8 = RelativeItem(Tree=divide_4.Points, Offset="{+1} (-1)", WrapPaths=False, WrapItems=False)  # -> ItemA, ItemB
ln_5 = Line(StartPoint=relitem_5.ItemA, EndPoint=relitem_5.ItemB)
ln_6 = Line(StartPoint=relitem_6.ItemA, EndPoint=relitem_6.ItemB)
ln_7 = Line(StartPoint=relitem_7.ItemA, EndPoint=relitem_7.ItemB)
ln_8 = Line(StartPoint=relitem_8.ItemA, EndPoint=relitem_8.ItemB)
Y_7 = UnitY(Factor=thickness)
X_4 = UnitX(Factor=thickness)
extr_2 = Extrude(Base=[ln_3, ln_4], Direction=X_4)
extr_3 = Extrude(Base=[ln_5, ln_6], Direction=X_4)
extr_4 = Extrude(Base=[ln_7, ln_8], Direction=Y_7)
merge = Merge(Data1=extr, Data2=extr_3, Data3=extr_4, Data4=extr_2)
preview = CustomPreview(Geometry=merge, Material=ColourSwatch(SwatchColor=RGB(123, 108, 130)))

context_bake = ContextBake(FacadeOutput=merge)
